# Grasshopper definition spaceFrame.gh (Grasshopper 0.9.76)

crv = Curve(Tree({0;0;0;0;0}: [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], {0;0;0;0;1}: [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], {0;0;0;0;2}: [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], {0;0;0;0;3}: [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], {0;0;0;0;4}: [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], {0;0;0;0;5}: [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]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))

# ----
# RUN
links = Line([Line((-44, 87, 0), (-42.65237653, 80.43713449, 5.428661001)), Line((-46.79999924, 77.40000153, 0), (-42.65237653, 80.43713449, 5.428661001)), Line((-36.76386261, 73.94772339, 8.019864082), (-42.65237653, 80.43713449, 5.428661001)), Line((-33.09999847, 80.5, 0), (-42.65237653, 80.43713449, 5.428661001)), Line((-33.09999847, 80.5, 0), (-28.28747241, 77.03729634, 7.429596267)), Line((-36.76386261, 73.94772339, 8.019864082), (-28.28747241, 77.03729634, 7.429596267))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])
upperlayer = Line([Line((-46.61737309, 71.85997699, 7.534335768), (-34.3841347, 68.29670427, 15.26762447)), Line((-34.3841347, 68.29670427, 15.26762447), (-28.28747241, 77.03729634, 7.429596267)), Line((-28.28747241, 77.03729634, 7.429596267), (-42.65237653, 80.43713449, 5.428661001)), Line((-42.65237653, 80.43713449, 5.428661001), (-46.61737309, 71.85997699, 7.534335768)), Line((-34.3841347, 68.29670427, 15.26762447), (-21.05440755, 63.32070516, 17.92001674)), Line((-21.05440755, 63.32070516, 17.92001674), (-16.63221737, 70.78042571, 7.717927271))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])
lowerlayer = Line([Line((-44, 87, 0), (-46.79999924, 77.40000153, 0)), Line((-46.79999924, 77.40000153, 0), (-36.76386261, 73.94772339, 8.019864082)), Line((-36.76386261, 73.94772339, 8.019864082), (-33.09999847, 80.5, 0)), Line((-33.09999847, 80.5, 0), (-44, 87, 0)), Line((-36.76386261, 73.94772339, 8.019864082), (-25.37530899, 67.83876801, 10.04707718)), Line((-25.37530899, 67.83876801, 10.04707718), (-22.20000076, 74, 0))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])
pt = Point(flatten([Point(-72, -9, 0), Point(-69.19999695, 0.6000000238, 0), Point(-72, -9, 0), Point(-61.20000076, -13.60000038, 0), Point(-69.19999695, 0.6000000238, 0), Point(-66.40000153, 10.19999981, 0)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]))
list = ValueList({"Rectangular (d,b)": "STD R(m) ", "Rectangular hollow (d,b,tw,tf)": "STD RHS(m) ", "Circular (d)": "STD C(m) ", "Circular hollow (d,t)": "STD CHS(m) ", "I section (d,b,tw,tf)": "STD I(m) ", "Tee (d,b,tw,tf)": "STD T(m) ", "Channel (d,b,tw,tf)": "STD CH(m) ", "Angle (d,b,tw,tf)": "STD A(m) ", "Taper (d,bt,bb)": "STD TR(m) "}, selected="Circular hollow (d,t)")
dimensions = Panel("0.5 0.015")
restraintdirections = ValueList({"x": 1, "y": 2, "z": 4, "xx": 8, "yy": 16, "zz": 32}, selected=["x", "y", "z"])
sections = CSharpScript(Type=list, Dimensions=dimensions)  # -> out, A; inputs Type: String, Dimensions: list of String
# ---------- sections: C# ----------
    var Joined = new List<string>();
    for(int i = 0;i < Dimensions.Count;i++)
    {
      var Strings = new string[2]{Type,Dimensions[i]};
      Joined.Add(String.Join("", Strings));
    }
    A = Joined;
# ---------- end sections ----------
ma = MassAddition(Input=restraintdirections)  # -> Result, PartialResults
flatten = FlattenTree(Tree=[links, upperlayer, lowerlayer], Path="{0}")
run = BooleanToggle(False)
gsa_framework = CSharpScript(
    elements1D=flatten,
    elements2D=flatten(crv),
    sectionDescription=sections.A,
    supportPoints=pt,
    supportType=ma.Result,
    fileLocation="C:\Users\Harri\Desktop\GSAlink\apiLink.gwa",
    run=run,
    Reference=["C:\Program Files\Oasys\GSA 8.7\Interop.Gsa_8_7.dll", "C:\Users\Harri\Documents\GitHub\GsaHelper\src\GsaHelper\GsaHelper\bin\Debug\GsaHelper.dll"])  # -> flatten(out), A, B, C; inputs elements1D: list of Curve, elements2D: list of Polyline, sectionDescription: String, supportPoints: list of Point3d, supportType: Int32, fileLocation: String, run: Boolean
# ---------- gsa_framework: C# ----------
    //the tolerance to use when finding nodes smaller than this will be merged
    double tolerance = 0.1;

    if (run) {

      //////////////////////////////////////////////////////////////////////////////////////////
      //Step 0: create a controller object which will help us
      //////////////////////////////////////////////////////////////////////////////////////////
      GsaHelper.Controller controller = new GsaHelper.Controller(tolerance);

      //////////////////////////////////////////////////////////////////////////////////////////
      //add all the 1-d elements
      //////////////////////////////////////////////////////////////////////////////////////////

      List<GsaElement> elements = new List<GsaElement>();


      //1D Elements
      for(int i = 0;i < elements1D.Count;i++)
      {
        GsaElement element;
        List<Point3d> endPoints = new List<Point3d>();
        endPoints.Add(elements1D[i].PointAtStart);
        endPoints.Add(elements1D[i].PointAtEnd);
        if (controller.CreateElement(endPoints, elements.Count + 1, out element)) {
          element.Color = (int) Colours.MEDIUMBLUE;
          element.Property = 1;
          element.Group = 1;
          elements.Add(element);
        }
      }

      //////////////////////////////////////////////////////////////////////////////////////////
      //add all the 2-d elements
      //////////////////////////////////////////////////////////////////////////////////////////

      List<GsaElement> elements2d = new List<GsaElement>();
      //1D Elements
      for(int i = 0;i < elements2D.Count;i++)
      {
        GsaElement element;
        List<Point3d> endPoints = new List<Point3d>();

        for (int j = 0;j < elements2D[i].Count - 1;j++) {
          endPoints.Add(elements2D[i][j]);
        }
        if (controller.CreateElement(endPoints, elements.Count + 1, out element)) {
          element.Color = (int) Colours.MEDIUMBLUE;
          element.Property = 1;
          element.Group = 1;
          elements.Add(element);
        }
      }

      if (elements.Count() != 0) {
        controller.SetElements(elements, true);
      }

      //////////////////////////////////////////////////////////////////////////////////////////
      //add all the sections
      //////////////////////////////////////////////////////////////////////////////////////////

      List<GsaSection> sections = new List<GsaSection>();
      GsaSection section;

      //create 1D sections and assign material
      if(controller.Create1dSection(sectionDescription, sections.Count() + 1, (int) StandardMaterial.STEEL, out section)) {
        sections.Add(section);
      }

      if (sections.Count() != 0) {
        controller.GsaObject.SetSections(sections.ToArray(), true);
      }

      //create 2D sections, assign property (e.g. SHELL, LOAD PANEL etc) and assign material
      List<Gsa2dSection> twoDSections = new List<Gsa2dSection>();
      Gsa2dSection twoDSection;
      if(controller.Create2dSection(0.02, 1, (int) GsaHelper.StandardMaterial.GLASS, out twoDSection)) {
        twoDSection.type = GsaHelper.TwoDType.LOADPANEL;
        twoDSections.Add(twoDSection);
      }
      //as there is no gsaObject.set2dsections we need to use this for now:
      for (int i = 0; i < twoDSections.Count;i++) {
        controller.GsaObject.GwaCommand(twoDSections[i].CreateGWACommand());
      }


      //////////////////////////////////////////////////////////////////////////////////////////
      //set all the supports
      //////////////////////////////////////////////////////////////////////////////////////////

      List <GsaNode> nodes = new List<GsaNode>();

      for(int i = 0;i < supportPoints.Count;i++)
      {
        GsaNode node;
        if (controller.CreateNode(supportPoints[i], (int) supportType, out node)) {
          nodes.Add(node);
        }
      }

      if (nodes.Count() != 0) {
        controller.GsaObject.SetNodes(nodes.ToArray(), true);
      }

      //////////////////////////////////////////////////////////////////////////////////////////
      //load case and gravity load
      //////////////////////////////////////////////////////////////////////////////////////////

      //LOAD_TITLE.2 | case | title | type | source | category | dir | include | bridge
      controller.GsaObject.GwaCommand("SET,LOAD_TITLE,1,selfWeight,LC_PERM_SELF,1,~,NONE,INC_BOTH");
      //create gravity load
      //LOAD_GRAVITY.2 | name | list | case | x | y | z
      controller.GsaObject.GwaCommand("SET,LOAD_GRAVITY,gravity,all,1,0.0,0.0,-1.0");

      //create linearstatic analysis task
      //TASK | task | name | stage | GSS | solution (plus options for complex tasks, refer to gwa.html, or see below modal task)
      controller.GsaObject.GwaCommand("SET,TASK,1,Static,,GSS,SOL_STATIC");

      //create basic static analysis cases
      //ANAL | case | name | task | desc
      controller.GsaObject.GwaCommand("SET,ANAL,1,SelfWeight,1,L1");


      //////////////////////////////////////////////////////////////////////////////////////////
      //save and close
      //////////////////////////////////////////////////////////////////////////////////////////

      controller.GsaObject.SaveAs(fileLocation);
      controller.GsaObject.Close();

      controller.GsaObject.Open(fileLocation);
      controller.GsaObject.Analyse();
      controller.GsaObject.SaveAs(fileLocation);

      //////////////////////////////////////////////////////////////////////////////////////////
      //Grab a result and send out
      //////////////////////////////////////////////////////////////////////////////////////////

      string outputCase = "A1";
      NodeResult nodeResult;
      int status = controller.FetchNodeResults(outputCase, supportPoints[0], ResHeader.REF_DISP, out nodeResult);

      A = nodeResult.title;
      B = nodeResult.values;
      C = nodeResult.units;

      controller.GsaObject.Close();
    }
# ---------- end gsa_framework ----------

panel = Panel(gsa_framework.B)  # disabled
panel_2 = Panel(gsa_framework.C)  # disabled
panel_3 = Panel(gsa_framework.A)  # disabled
